# Grasshopper definition xmas.gh (Grasshopper 1.0.7)
# Copyright: AMDlab
# plug-ins: Kangaroo2 Components

置く範囲 = Rectangle({Plane=PlaneXY(25.09733563, 87.2839822, 0), Size=Domain2(u=-20.48222133..20.48222133, v=-27.26302498..27.26302498)})
範囲 = Rectangle({Plane=PlaneXY(25.16892242, 59.80406303, -0.1), Size=Domain2(u=-25.16892242..25.16892242, v=-59.80406303..59.80406303)})

# ----
# プレゼント箱
黄緑 = Curve([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])
赤 = Curve(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)
黒 = Curve([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])

# ----
# ヒイラギ
赤_2 = Curve([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])
黒_2 = Curve([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])
緑 = Curve([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])

# ----
# 杖のキャンディ
赤_3 = Curve(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)
白 = Curve([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])

relay = Relay([黄緑, 黒, 赤])
relay_2 = Relay([赤_3, 白])
relay_3 = Relay([赤_2, 黒_2, 緑])
置く範囲_2 = Rectangle(置く範囲)

個数 = Integer(Slider(23, range=5..30))
entwine = Entwine(Branch00=relay, Branch01=relay_2, Branch02=relay_3, FlattenInputs=True)
random = Random(Range="0 To 3", Number=個数, Seed=2)
bbox = BoundingBox(Content=entwine, Plane=PlaneXY(0, 0, 0), UnionBox=True)  # -> flatten(Box), Box_2
round = Round(Number=random)  # -> Nearest, Floor, Ceiling
area = Area(Geometry=bbox.Box)  # -> Area, Centroid
item = ListItem(List=area.Centroid, Index=round.Floor, Wrap=True)
panel = Panel("""0
1
2""")
equals = Equality(FirstNumber=round.Floor, SecondNumber=graft(panel))  # -> Equality, Inequality

個数_2 = Integer(個数)
個数_3 = Integer(個数_2)

pop2d = Populate2D(Region=置く範囲_2, Count=個数_2, Seed=1)
random_2 = Random(Range="0.8 To 1.2", Number=個数_3, Seed=2)
random_3 = Random(Range="0 To Pi*2", Number=個数_3, Seed=2)
subtraction = Subtraction(A=pop2d, B=item)
move = Move(Motion=subtraction)  # -> Geometry, Transform
rotate = Rotate(Angle=random_3, Plane=pop2d)  # -> Geometry, Transform
scale = Scale(Center=pop2d, Factor=random_2)  # -> Geometry, Transform
entwine_2 = Entwine(Branch00=move.Transform, Branch01=rotate.Transform, Branch02=scale.Transform, FlattenInputs=True)
flip = FlipMatrix(Data=entwine_2)
comp = Compound(Transforms=flip)  # -> flatten(Compound)
cull = CullPattern(List=comp, CullPattern=equals.Equality)
bang = ExplodeTree(Data=cull)  # -> Branch0, Branch1, Branch2

graft = GraftTree(Tree=bang.Branch0, IncludeEmptyLists=True, IncludeNullItems=True)
graft_2 = GraftTree(Tree=bang.Branch2, IncludeEmptyLists=True, IncludeNullItems=True)
graft_3 = GraftTree(Tree=bang.Branch1, IncludeEmptyLists=True, IncludeNullItems=True)
transform = Transform(Geometry=黄緑, Transform=graft)
transform_2 = Transform(Geometry=黒, Transform=graft)
transform_3 = Transform(Geometry=赤, Transform=graft)
transform_4 = Transform(Geometry=赤_3, Transform=graft_3)
transform_5 = Transform(Geometry=白, Transform=graft_3)
transform_6 = Transform(Geometry=赤_2, Transform=graft_2)
transform_7 = Transform(Geometry=黒_2, Transform=graft_2)
transform_8 = Transform(Geometry=緑, Transform=graft_2)
relay_4 = Relay([transform_4, transform_5])
relay_5 = Relay([transform, transform_2, transform_3])
relay_6 = Relay([transform_6, transform_7, transform_8])

entwine_3 = Entwine(
    Branch00=transform,
    Branch01=[transform_2, transform_7],
    Branch02=[transform_3, transform_4, transform_6],
    Branch03=transform_5,
    Branch04=transform_8,
    FlattenInputs=True)
show = Show(G=entwine_3)

entwine_4 = Entwine(Branch0X=relay_5, Branch1X=relay_4, Branch2X=relay_6, FlattenInputs=False)
explode = Explode(Curve=entwine_4, Recursive=True)  # -> Segments, Vertices
trim = TrimTree(Tree=explode.Vertices, Depth=1)
hull = ConvexHull(Points=trim, Plane=PlaneXY(0, 0, 0))  # -> flatten(Hull), HullZ, Indices
flatten = FlattenTree(Tree=explode.Vertices, Path="{0}")
Y = UnitY(Factor=Slider(-0.01, range=-1..0))
範囲_2 = Rectangle(範囲)
rigidpointset = RigidPointSet(Points=trim, Strength=Slider(1, range=1..10))  # -> RigidBody, Planes
grab = Grab(On=True, Strength=1, Range=3)
onplane = OnPlane(Points=flatten, Plane=PlaneXY(0, 0, 0), Strength=1)
onmesh = OnMesh(Points=flatten, Mesh=範囲_2, Strength=1)
cc = CurveCollide(Curves=hull.Hull, Frames=flatten(rigidpointset.Planes), BasePlane=PlaneXY(0, 0, 0), Strength=1)  # -> Goal, Frames
load = Load(Point=flatten, ForceVector=Y, Weighting=1)
merge = Merge(Data1=grab, Data2=load, Data3=rigidpointset.RigidBody, Data4=onplane, Data5=onmesh, Data6=cc.Goal)  # -> flatten(Result)

entwine_5 = Entwine(Branch0X=show, Branch1X=merge, FlattenInputs=False)
bouncysolver = BouncySolver(
    GoalObjects=entwine_5,
    Reset=Button(),
    Threshold=1e-15,
    Tolerance=0.0001,
    Damping=Slider(0.99, range=0..1),
    Iterations=Slider(10, range=1..10),
    On=Toggle(False))  # -> I, V, O
unflatten = UnflattenTree(Tree=bouncysolver.O, Guide=entwine_5)
bang_2 = ExplodeTree(Data=unflatten)  # -> Branch0, Branch1, Branch2, Branch3, Branch4, Branch5

mesh = Mesh(bang_2.Branch2)
mesh_2 = Mesh(bang_2.Branch0)
mesh_3 = Mesh(bang_2.Branch1)
mesh_4 = Mesh(bang_2.Branch3)
mesh_5 = Mesh(bang_2.Branch4)
pt = Point(Point(0, 0, 10))
pt_2 = Point(Point(0, 0, 10))
move_2 = Move(Geometry=mesh_3, Motion=pt)  # -> Geometry, Transform
move_3 = Move(Geometry=mesh_4, Motion=pt_2)  # -> Geometry, Transform
preview = CustomPreview(Geometry=mesh_2, Material=ColourSwatch(SwatchColor=RGB(151, 196, 27)))
preview_2 = CustomPreview(Geometry=move_2.Geometry, Material=ColourSwatch(SwatchColor=RGBA(0, 0, 0, 169)))
preview_3 = CustomPreview(Geometry=mesh, Material=ColourSwatch(SwatchColor=RGB(199, 22, 31)))
preview_4 = CustomPreview(Geometry=move_3.Geometry, Material=ColourSwatch(SwatchColor=RGB(255, 255, 255)))
preview_5 = CustomPreview(Geometry=mesh_5, Material=ColourSwatch(SwatchColor=RGBA(0, 145, 63, 205)))
